% Simulink data dictionary canrx_0x586.sldd

R64 = Simulink.AliasType(BaseType="double")
R32 = Simulink.AliasType(BaseType="single")
SD = Simulink.AliasType(BaseType="int32")
SW = Simulink.AliasType(BaseType="int16")
SB = Simulink.AliasType(BaseType="int8")
UD = Simulink.AliasType(BaseType="uint32")
UW = Simulink.AliasType(BaseType="uint16")
UB = Simulink.AliasType(BaseType="uint8")
BOOL = Simulink.AliasType(BaseType="boolean")
SI = Simulink.NumericType(DataTypeMode="Fixed-point: unspecified scaling", SignednessBool=true, WordLength=32, FixedExponent=0)
UI = Simulink.NumericType(DataTypeMode="Fixed-point: unspecified scaling", SignednessBool=false, WordLength=32, FixedExponent=0)
CH = Simulink.NumericType(DataTypeMode="Fixed-point: unspecified scaling", SignednessBool=true, WordLength=8, FixedExponent=0)
SO = Simulink.NumericType(DataTypeMode="Fixed-point: unspecified scaling", SignednessBool=true, WordLength=64, FixedExponent=0)
UO = Simulink.NumericType(DataTypeMode="Fixed-point: unspecified scaling", SignednessBool=false, WordLength=64, FixedExponent=0)
SLDD_CFG = Simulink.ConfigSet(StartTime="0", StopTime="10", Solver="FixedStepDiscrete", ProdHWDeviceType="Infineon->TriCore", SystemTargetFile="ert.tlc", TargetLang="C")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
K_CAN_GMLAN_RX_INVALID_SELECT = Simulink.Parameter(0, StorageClass="ImportedExtern", DataType="boolean")
PLCANC_APCNTL_RQST_SEL_J1939 = Simulink.Parameter(0, StorageClass="ImportedExtern", DataType="boolean")
PLCANC_APCNTL_RQST_SEL_GMLAN = Simulink.Parameter(1, StorageClass="ImportedExtern", DataType="boolean")
inv_device_vnt = Simulink.Signal(StorageClass="ImportedExtern", DataType="fixdt(0, 8, 1/1)")
can_j1939_rx_invalid_gps_direction = Simulink.Signal(StorageClass="ImportedExtern", DataType="fixdt(0, 16, 1/1)")
can_j1939_rx_gps_direction = Simulink.Signal(StorageClass="ImportedExtern", DataType="fixdt(0, 16, 1/1)")
can_j1939_rx_invalid_gps_hdop = Simulink.Signal(StorageClass="ImportedExtern", DataType="fixdt(0, 16, 1/1)")
can_j1939_rx_gps_hdop = Simulink.Signal(StorageClass="ImportedExtern", DataType="fixdt(0, 16, 1/1)")
can_j1939_rx_invalid_gps_latitude = Simulink.Signal(StorageClass="ImportedExtern", DataType="fixdt(0, 16, 1/1)")
can_j1939_rx_gps_latitude = Simulink.Signal(StorageClass="ImportedExtern", DataType="fixdt(0, 16, 1/1)")
can_invalid_can_rqst_gps_sg_ub = Simulink.Signal(StorageClass="ExportedGlobal", DataType="fixdt(0, 8, 1/1)")
can_rqst_gps_sg_ub = Simulink.Signal(StorageClass="ExportedGlobal", DataType="fixdt(0, 8, 1/1)")
can_invalid_can_rqst_gps_altitude = Simulink.Signal(StorageClass="ExportedGlobal", DataType="fixdt(0, 8, 1/1)")
can_rqst_gps_altitude = Simulink.Signal(StorageClass="ExportedGlobal", DataType="fixdt(0, 8, 1/1)")
can_invalid_can_rqst_gps_antenna_stat = Simulink.Signal(StorageClass="ExportedGlobal", DataType="fixdt(0, 8, 1/1)")
can_rqst_gps_antenna_stat = Simulink.Signal(StorageClass="ExportedGlobal", DataType="fixdt(0, 8, 1/1)")
can_invalid_can_rqst_gps_direction = Simulink.Signal(StorageClass="ExportedGlobal", DataType="fixdt(0, 16, 1/1)")
can_rqst_gps_direction = Simulink.Signal(StorageClass="ExportedGlobal", DataType="fixdt(0, 16, 1/1)")
can_invalid_can_rqst_gps_hdop = Simulink.Signal(StorageClass="ExportedGlobal", DataType="fixdt(0, 16, 1/1)")
can_rqst_gps_hdop = Simulink.Signal(StorageClass="ExportedGlobal", DataType="fixdt(0, 16, 1/1)")
can_invalid_can_rqst_gps_latitude = Simulink.Signal(StorageClass="ExportedGlobal", DataType="fixdt(0, 16, 1/1)")
can_rqst_gps_latitude = Simulink.Signal(StorageClass="ExportedGlobal", DataType="fixdt(0, 16, 1/1)")
can_invalid_can_rqst_gps_longitude = Simulink.Signal(StorageClass="ExportedGlobal", DataType="fixdt(0, 16, 1/1)")
can_rqst_gps_longitude = Simulink.Signal(StorageClass="ExportedGlobal", DataType="fixdt(0, 16, 1/1)")
can_invalid_can_rqst_gps_time = Simulink.Signal(StorageClass="ExportedGlobal", DataType="fixdt(0, 32, 1/1)")
can_rqst_gps_time = Simulink.Signal(StorageClass="ExportedGlobal", DataType="fixdt(0, 32, 1/1)")
can_invalid_can_rqst_gps_veh_speed = Simulink.Signal(StorageClass="ExportedGlobal", DataType="fixdt(0, 32, 1/1)")
can_rqst_gps_veh_speed = Simulink.Signal(StorageClass="ExportedGlobal", DataType="fixdt(0, 32, 1/1)")
can_gmlan_rx_invalid_gps_altitude = Simulink.Signal(StorageClass="ExportedGlobal", DataType="fixdt(0, 8, 1/1)")
can_gmlan_rx_gps_altitude = Simulink.Signal(StorageClass="ExportedGlobal", DataType="fixdt(0, 8, 1/1)")
D_GPS_ALTITUDE_MIN = Simulink.Parameter(0, StorageClass="Define", DataType="UB")
D_GPS_ALTITUDE_MAX = Simulink.Parameter(256, StorageClass="Define", DataType="UB")
can_gmlan_rx_invalid_gps_antenna_stat = Simulink.Signal(StorageClass="ExportedGlobal", DataType="fixdt(0, 8, 1/1)")
can_gmlan_rx_gps_antenna_stat = Simulink.Signal(StorageClass="ExportedGlobal", DataType="fixdt(0, 8, 1/1)")
D_GPS_ANTENNA_STAT_MIN = Simulink.Parameter(0, StorageClass="Define", DataType="UB")
D_GPS_ANTENNA_STAT_MAX = Simulink.Parameter(256, StorageClass="Define", DataType="UB")
can_gmlan_rx_invalid_gps_direction = Simulink.Signal(StorageClass="ExportedGlobal", DataType="fixdt(0, 16, 1/1)")
can_gmlan_rx_gps_direction = Simulink.Signal(StorageClass="ExportedGlobal", DataType="fixdt(0, 16, 1/1)")
D_GPS_DIRECTION_MIN = Simulink.Parameter(0, StorageClass="Define", DataType="UW")
D_GPS_DIRECTION_MAX = Simulink.Parameter(65535, StorageClass="Define", DataType="UW")
can_gmlan_rx_invalid_gps_hdop = Simulink.Signal(StorageClass="ExportedGlobal", DataType="fixdt(0, 16, 1/1)")
can_gmlan_rx_gps_hdop = Simulink.Signal(StorageClass="ExportedGlobal", DataType="fixdt(0, 16, 1/1)")
D_GPS_HDOP_MIN = Simulink.Parameter(0, StorageClass="Define", DataType="UW")
D_GPS_HDOP_MAX = Simulink.Parameter(65535, StorageClass="Define", DataType="UW")
can_gmlan_rx_invalid_gps_latitude = Simulink.Signal(StorageClass="ExportedGlobal", DataType="fixdt(0, 16, 1/1)")
can_gmlan_rx_gps_latitude = Simulink.Signal(StorageClass="ExportedGlobal", DataType="fixdt(0, 16, 1/1)")
D_GPS_LATITUDE_MIN = Simulink.Parameter(0, StorageClass="Define", DataType="UW")
D_GPS_LATITUDE_MAX = Simulink.Parameter(65535, StorageClass="Define", DataType="UW")
can_gmlan_rx_invalid_gps_longitude = Simulink.Signal(StorageClass="ExportedGlobal", DataType="fixdt(0, 16, 1/1)")
can_gmlan_rx_gps_longitude = Simulink.Signal(StorageClass="ExportedGlobal", DataType="fixdt(0, 16, 1/1)")
D_GPS_LONGITUDE_MIN = Simulink.Parameter(0, StorageClass="Define", DataType="UW")
D_GPS_LONGITUDE_MAX = Simulink.Parameter(65535, StorageClass="Define", DataType="UW")
can_gmlan_rx_invalid_gps_sg_ub = Simulink.Signal(StorageClass="ExportedGlobal", DataType="fixdt(0, 8, 1/1)")
can_gmlan_rx_gps_sg_ub = Simulink.Signal(StorageClass="ExportedGlobal", DataType="fixdt(0, 8, 1/1)")
D_GPS_SG_UB_MIN = Simulink.Parameter(0, StorageClass="Define", DataType="UB")
D_GPS_SG_UB_MAX = Simulink.Parameter(256, StorageClass="Define", DataType="UB")
can_gmlan_rx_invalid_gps_time = Simulink.Signal(StorageClass="ExportedGlobal", DataType="fixdt(0, 32, 1/1)")
can_gmlan_rx_gps_time = Simulink.Signal(StorageClass="ExportedGlobal", DataType="fixdt(0, 32, 1/1)")
D_GPS_TIME_MIN = Simulink.Parameter(0, StorageClass="Define", DataType="UD")
D_GPS_TIME_MAX = Simulink.Parameter(10000000, StorageClass="Define", DataType="UD")
can_gmlan_rx_invalid_gps_veh_speed = Simulink.Signal(StorageClass="ExportedGlobal", DataType="fixdt(0, 32, 1/1)")
can_gmlan_rx_gps_veh_speed = Simulink.Signal(StorageClass="ExportedGlobal", DataType="fixdt(0, 32, 1/1)")
D_GPS_VEH_SPEED_MIN = Simulink.Parameter(0, StorageClass="Define", DataType="UD")
D_GPS_VEH_SPEED_MAX = Simulink.Parameter(10000000, StorageClass="Define", DataType="UD")
can_invalid_can_rx_gps_altitude = Simulink.Signal(StorageClass="ExportedGlobal", DataType="fixdt(0, 8, 1/1)")
can_rx_gps_altitude = Simulink.Signal(StorageClass="ExportedGlobal", DataType="fixdt(0, 8, 1/1)")
can_invalid_can_rx_gps_antenna_stat = Simulink.Signal(StorageClass="ExportedGlobal", DataType="fixdt(0, 8, 1/1)")
can_rx_gps_antenna_stat = Simulink.Signal(StorageClass="ExportedGlobal", DataType="fixdt(0, 8, 1/1)")
can_invalid_can_rx_gps_direction = Simulink.Signal(StorageClass="ExportedGlobal", DataType="fixdt(0, 16, 1/1)")
can_rx_gps_direction = Simulink.Signal(StorageClass="ExportedGlobal", DataType="fixdt(0, 16, 1/1)")
can_invalid_can_rx_gps_hdop = Simulink.Signal(StorageClass="ExportedGlobal", DataType="fixdt(0, 16, 1/1)")
can_rx_gps_hdop = Simulink.Signal(StorageClass="ExportedGlobal", DataType="fixdt(0, 16, 1/1)")
can_invalid_can_rx_gps_latitude = Simulink.Signal(StorageClass="ExportedGlobal", DataType="fixdt(0, 16, 1/1)")
can_rx_gps_latitude = Simulink.Signal(StorageClass="ExportedGlobal", DataType="fixdt(0, 16, 1/1)")
can_invalid_can_rx_gps_longitude = Simulink.Signal(StorageClass="ExportedGlobal", DataType="fixdt(0, 16, 1/1)")
can_rx_gps_longitude = Simulink.Signal(StorageClass="ExportedGlobal", DataType="fixdt(0, 16, 1/1)")
can_invalid_can_rx_gps_sg_ub = Simulink.Signal(StorageClass="ExportedGlobal", DataType="fixdt(0, 8, 1/1)")
can_rx_gps_sg_ub = Simulink.Signal(StorageClass="ExportedGlobal", DataType="fixdt(0, 8, 1/1)")
can_invalid_can_rx_gps_time = Simulink.Signal(StorageClass="ExportedGlobal", DataType="fixdt(0, 32, 1/1)")
can_rx_gps_time = Simulink.Signal(StorageClass="ExportedGlobal", DataType="fixdt(0, 32, 1/1)")
can_invalid_can_rx_gps_veh_speed = Simulink.Signal(StorageClass="ExportedGlobal", DataType="fixdt(0, 32, 1/1)")
can_rx_gps_veh_speed = Simulink.Signal(StorageClass="ExportedGlobal", DataType="fixdt(0, 32, 1/1)")
K_CAN_GMLAN_RX_DEFAULT_GPS_ALTITUDE = Simulink.Parameter(0, StorageClass="ImportedExtern", DataType="fixdt(0, 8, 1/1)")
K_CAN_GMLAN_RX_DEFAULT_GPS_ANTENNA_STAT = Simulink.Parameter(0, StorageClass="ImportedExtern", DataType="fixdt(0, 8, 1/1)")
K_CAN_GMLAN_RX_DEFAULT_GPS_DIRECTION = Simulink.Parameter(0, StorageClass="ImportedExtern", DataType="fixdt(0, 8, 1/1)")
K_CAN_GMLAN_RX_DEFAULT_GPS_HDOP = Simulink.Parameter(0, StorageClass="ImportedExtern", DataType="fixdt(0, 16, 1/1)")
K_CAN_GMLAN_RX_DEFAULT_GPS_LATITUDE = Simulink.Parameter(0, StorageClass="ImportedExtern", DataType="fixdt(0, 16, 1/1)")
K_CAN_GMLAN_RX_DEFAULT_GPS_LONGITUDE = Simulink.Parameter(0, StorageClass="ImportedExtern", DataType="fixdt(0, 16, 1/1)")
K_CAN_GMLAN_RX_DEFAULT_GPS_SG_UB = Simulink.Parameter(0, StorageClass="ImportedExtern", DataType="fixdt(0, 8, 1/1)")
K_CAN_GMLAN_RX_DEFAULT_GPS_TIME = Simulink.Parameter(0, StorageClass="ImportedExtern", DataType="fixdt(0, 32, 1/1)")
K_CAN_GMLAN_RX_DEFAULT_GPS_VEH_SPEED = Simulink.Parameter(0, StorageClass="ImportedExtern", DataType="fixdt(0, 32, 1/1)")
K_CAN_RQST_SEL_2 = Simulink.Parameter(0, StorageClass="ImportedExtern", DataType="fixdt(0, 16, 1/1)")
K_RQST_DRCT_2 = Simulink.Parameter(0, StorageClass="ImportedExtern", DataType="fixdt(0, 16, 1/1)")