% Simulink data dictionary canrx_0x6A2.sldd

R64 = Simulink.AliasType(BaseType="double")
R32 = Simulink.AliasType(BaseType="single")
SD = Simulink.AliasType(BaseType="int32")
SW = Simulink.AliasType(BaseType="int16")
SB = Simulink.AliasType(BaseType="int8")
UD = Simulink.AliasType(BaseType="uint32")
UW = Simulink.AliasType(BaseType="uint16")
UB = Simulink.AliasType(BaseType="uint8")
BOOL = Simulink.AliasType(BaseType="boolean")
SI = Simulink.NumericType(DataTypeMode="Fixed-point: unspecified scaling", SignednessBool=true, WordLength=32, FixedExponent=0)
UI = Simulink.NumericType(DataTypeMode="Fixed-point: unspecified scaling", SignednessBool=false, WordLength=32, FixedExponent=0)
CH = Simulink.NumericType(DataTypeMode="Fixed-point: unspecified scaling", SignednessBool=true, WordLength=8, FixedExponent=0)
SO = Simulink.NumericType(DataTypeMode="Fixed-point: unspecified scaling", SignednessBool=true, WordLength=64, FixedExponent=0)
UO = Simulink.NumericType(DataTypeMode="Fixed-point: unspecified scaling", SignednessBool=false, WordLength=64, FixedExponent=0)
SLDD_CFG = Simulink.ConfigSet(StartTime="0", StopTime="10", Solver="FixedStepDiscrete", ProdHWDeviceType="Infineon->TriCore", SystemTargetFile="ert.tlc", TargetLang="C")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
K_CAN_GMLAN_RX_INVALID_SELECT = Simulink.Parameter(0, StorageClass="ImportedExtern", DataType="boolean")
PLCANC_APCNTL_RQST_SEL_J1939 = Simulink.Parameter(0, StorageClass="ImportedExtern", DataType="boolean")
PLCANC_APCNTL_RQST_SEL_GMLAN = Simulink.Parameter(1, StorageClass="ImportedExtern", DataType="boolean")
inv_device_vnt = Simulink.Signal(StorageClass="ImportedExtern", DataType="fixdt(0, 8, 1/1)")
can_invalid_can_rqst_anmsig_vcm_can02 = Simulink.Signal(StorageClass="ExportedGlobal", DataType="fixdt(0, 16, 1/1)")
can_rqst_anmsig_vcm_can02 = Simulink.Signal(StorageClass="ExportedGlobal", DataType="fixdt(0, 16, 1/1)")
can_gmlan_rx_invalid_anmsig_vcm_can02 = Simulink.Signal(StorageClass="ExportedGlobal", DataType="fixdt(0, 16, 1/1)")
can_gmlan_rx_anmsig_vcm_can02 = Simulink.Signal(StorageClass="ExportedGlobal", DataType="fixdt(0, 16, 1/1)")
D_ANMSIG_VCM_CAN02_MIN = Simulink.Parameter(0, StorageClass="Define", DataType="UW")
D_ANMSIG_VCM_CAN02_MAX = Simulink.Parameter(65535, StorageClass="Define", DataType="UW")
can_invalid_can_rx_anmsig_vcm_can02 = Simulink.Signal(StorageClass="ExportedGlobal", DataType="fixdt(0, 16, 1/1)")
can_rx_anmsig_vcm_can02 = Simulink.Signal(StorageClass="ExportedGlobal", DataType="fixdt(0, 16, 1/1)")
K_CAN_GMLAN_RX_DEFAULT_ANMSIG_VCM_CAN02 = Simulink.Parameter(0, StorageClass="ImportedExtern", DataType="fixdt(0, 8, 1/1)")
K_CAN_RQST_SEL_2 = Simulink.Parameter(0, StorageClass="ImportedExtern", DataType="fixdt(0, 16, 1/1)")
K_RQST_DRCT_2 = Simulink.Parameter(0, StorageClass="ImportedExtern", DataType="fixdt(0, 16, 1/1)")