% Simulink data dictionary canrx_0x1BF.sldd

R64 = Simulink.AliasType(BaseType="double")
R32 = Simulink.AliasType(BaseType="single")
SD = Simulink.AliasType(BaseType="int32")
SW = Simulink.AliasType(BaseType="int16")
SB = Simulink.AliasType(BaseType="int8")
UD = Simulink.AliasType(BaseType="uint32")
UW = Simulink.AliasType(BaseType="uint16")
UB = Simulink.AliasType(BaseType="uint8")
BOOL = Simulink.AliasType(BaseType="boolean")
SI = Simulink.NumericType(DataTypeMode="Fixed-point: unspecified scaling", SignednessBool=true, WordLength=32, FixedExponent=0)
UI = Simulink.NumericType(DataTypeMode="Fixed-point: unspecified scaling", SignednessBool=false, WordLength=32, FixedExponent=0)
CH = Simulink.NumericType(DataTypeMode="Fixed-point: unspecified scaling", SignednessBool=true, WordLength=8, FixedExponent=0)
SO = Simulink.NumericType(DataTypeMode="Fixed-point: unspecified scaling", SignednessBool=true, WordLength=64, FixedExponent=0)
UO = Simulink.NumericType(DataTypeMode="Fixed-point: unspecified scaling", SignednessBool=false, WordLength=64, FixedExponent=0)
K_CAN_GMLAN_RX_INVALID_SELECT = Simulink.Parameter(0, StorageClass="ImportedExtern", DataType="boolean")
SLDD_CFG = Simulink.ConfigSet(StartTime="0", StopTime="10", Solver="FixedStepDiscrete", ProdHWDeviceType="Infineon->TriCore", SystemTargetFile="ert.tlc", TargetLang="C")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
K_CAN_GMLAN_RX_DEFAULT_TRB_DUTY = Simulink.Parameter(0, StorageClass="ExportedGlobal", DataType="fixdt(1, 8, 1/1)")
K_CAN_GMLAN_RX_DEFAULT_TRB_POWER_OFF_ENB_STAT = Simulink.Parameter(0, StorageClass="ExportedGlobal", DataType="fixdt(0, 8, 1/1)")
K_CAN_GMLAN_RX_DEFAULT_TRB_CTRL_ENB_STAT = Simulink.Parameter(0, StorageClass="ExportedGlobal", DataType="fixdt(0, 8, 1/1)")
K_CAN_GMLAN_RX_DEFAULT_VNT_ACT_POS = Simulink.Parameter(0, StorageClass="ExportedGlobal", DataType="fixdt(0, 16, 1/128)")
K_CAN_GMLAN_RX_DEFAULT_TRB_ERR_MSG = Simulink.Parameter(0, StorageClass="ExportedGlobal", DataType="fixdt(0, 16, 1/1)")
trb_duty = Simulink.Signal(StorageClass="SimulinkGlobal", DataType="fixdt(1,8,1,0)")
trb_power_off_enb_stat = Simulink.Signal(StorageClass="SimulinkGlobal", DataType="fixdt(0,1,1,0)")
trb_ctrl_enb_stat = Simulink.Signal(StorageClass="SimulinkGlobal", DataType="fixdt(0,1,1,0)")
vnt_act_pos = Simulink.Signal(StorageClass="SimulinkGlobal", DataType="fixdt(0,10,0.1,0)")
trb_err_msg = Simulink.Signal(StorageClass="SimulinkGlobal", DataType="fixdt(0,16,1,0)")
inv_device_vnt = Simulink.Signal(StorageClass="ImportedExtern", DataType="fixdt(0, 8, 1/1)", InitialValue="0")
can_gmlan_rx_invalid_trb_duty = Simulink.Signal(StorageClass="ExportedGlobal", DataType="fixdt(0, 8, 1/1)", InitialValue="0")
sbplcani_rx_trb_duty = Simulink.Signal(StorageClass="ExportedGlobal", DataType="fixdt(1, 8, 1/1)", InitialValue="K_CAN_GMLAN_RX_DEFAULT_TRB_DUTY")
can_gmlan_rx_invalid_trb_power_off_enb_stat = Simulink.Signal(StorageClass="ExportedGlobal", DataType="fixdt(0, 8, 1/1)", InitialValue="0")
ubplcani_rx_trb_power_off_enb_stat = Simulink.Signal(StorageClass="ExportedGlobal", DataType="fixdt(0, 8, 1/1)", InitialValue="K_CAN_GMLAN_RX_DEFAULT_TRB_POWER_OFF_ENB_STAT")
can_gmlan_rx_invalid_trb_ctrl_enb_stat = Simulink.Signal(StorageClass="ExportedGlobal", DataType="fixdt(0, 8, 1/1)", InitialValue="0")
ubplcani_rx_trb_ctrl_enb_stat = Simulink.Signal(StorageClass="ExportedGlobal", DataType="fixdt(0, 8, 1/1)", InitialValue="K_CAN_GMLAN_RX_DEFAULT_TRB_CTRL_ENB_STAT")
can_gmlan_rx_invalid_vnt_act_pos = Simulink.Signal(StorageClass="ExportedGlobal", DataType="fixdt(0, 8, 1/1)", InitialValue="0")
uwplcani_rx_vnt_act_pos = Simulink.Signal(StorageClass="ExportedGlobal", DataType="fixdt(0, 16, 1/128)", InitialValue="K_CAN_GMLAN_RX_DEFAULT_VNT_ACT_POS")
can_gmlan_rx_invalid_trb_err_msg = Simulink.Signal(StorageClass="ExportedGlobal", DataType="fixdt(0, 8, 1/1)", InitialValue="0")
uwplcani_rx_trb_err_msg = Simulink.Signal(StorageClass="ExportedGlobal", DataType="fixdt(0, 16, 1/1)", InitialValue="K_CAN_GMLAN_RX_DEFAULT_TRB_ERR_MSG")