% Simulink data dictionary cantx_0x191.sldd

R64 = Simulink.AliasType(BaseType="double")
R32 = Simulink.AliasType(BaseType="single")
SD = Simulink.AliasType(BaseType="int32")
SW = Simulink.AliasType(BaseType="int16")
SB = Simulink.AliasType(BaseType="int8")
UD = Simulink.AliasType(BaseType="uint32")
UW = Simulink.AliasType(BaseType="uint16")
UB = Simulink.AliasType(BaseType="uint8")
BOOL = Simulink.AliasType(BaseType="boolean")
SI = Simulink.NumericType(DataTypeMode="Fixed-point: unspecified scaling", SignednessBool=true, WordLength=32, FixedExponent=0)
UI = Simulink.NumericType(DataTypeMode="Fixed-point: unspecified scaling", SignednessBool=false, WordLength=32, FixedExponent=0)
CH = Simulink.NumericType(DataTypeMode="Fixed-point: unspecified scaling", SignednessBool=true, WordLength=8, FixedExponent=0)
SO = Simulink.NumericType(DataTypeMode="Fixed-point: unspecified scaling", SignednessBool=true, WordLength=64, FixedExponent=0)
UO = Simulink.NumericType(DataTypeMode="Fixed-point: unspecified scaling", SignednessBool=false, WordLength=64, FixedExponent=0)

PLCANI_APCNTL_SET_INF_TYPE = enum(DataScope="Exported", DefaultValue="PLCANI_APCNTL_SET_INF_2X")
  PLCANI_APCNTL_SET_INF_2X = 0
  PLCANI_APCNTL_SET_INF_4X = 1
  PLCANI_APCNTL_SET_INF_8X = 2
  PLCANI_APCNTL_SET_INF_16X = 3
  PLCANI_APCNTL_SET_INF_32X = 4
  PLCANI_APCNTL_SET_INF_128X = 5
  PLCANI_APCNTL_SET_INF_REF = 6
  PLCANI_APCNTL_SET_INF_256X = 10
  PLCANI_APCNTL_SET_INF_64X = 11
  PLCANI_APCNTL_SET_INF_25X = 13
  PLCANI_APCNTL_SET_INF_250X = 14
  PLCANI_APCNTL_SET_INF_INIT = 99

canframe = Simulink.Bus()
  Byte0: uint8
  Byte1: uint8
  Byte2: uint8
  Byte3: uint8
  Byte4: uint8
  Byte5: uint8
  Byte6: uint8
  Byte7: uint8

SLDD_CFG = Simulink.ConfigSet(StartTime="0", StopTime="10", Solver="FixedStepDiscrete", ProdHWDeviceType="Infineon->TriCore", SystemTargetFile="ert.tlc", TargetLang="C")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
can_tx_inf_eng_tra_rdctn_fail_stat = Simulink.Signal(StorageClass="SimulinkGlobal", DataType="fixdt(0,1,1,0)")
can_tx_inf_eng_trq_tcm_rqst_fail_stat = Simulink.Signal(StorageClass="SimulinkGlobal", DataType="fixdt(0,1,1,0)")
can_tx_inf_trq_crnk_shft = Simulink.Signal(StorageClass="SimulinkGlobal", DataType="fixdt(1,12,0.5,-848)")
can_tx_inf_aps_pos_pt_validity = Simulink.Signal(StorageClass="SimulinkGlobal", DataType="fixdt(0,1,1,0)")
can_tx_inf_tra_non_reg = Simulink.Signal(StorageClass="SimulinkGlobal", DataType="fixdt(1,12,0.5,-848)")
can_tx_inf_aps_pos_eff = Simulink.Signal(StorageClass="SimulinkGlobal", DataType="fixdt(0,8,100/255,0)")
ubplcan_apcntl_inf_eng_tra_rdctn_fail_stat = Simulink.Signal(StorageClass="ImportedExtern", DataType="fixdt(0, 8, 1/1)")
ubplcan_apcntl_inf_eng_trq_tcm_rqst_fail_stat = Simulink.Signal(StorageClass="ImportedExtern", DataType="fixdt(0, 8, 1/1)")
swplcan_apcntl_inf_trq_crnk_shft = Simulink.Signal(StorageClass="ImportedExtern", DataType="fixdt(1, 16, 1/8)")
ubplcan_apcntl_inf_aps_pos_pt_validity = Simulink.Signal(StorageClass="ImportedExtern", DataType="fixdt(0, 8, 1/1)")
swbplcan_apcntl_inf_tra_non_reg = Simulink.Signal(StorageClass="ImportedExtern", DataType="fixdt(1, 16, 1/8)")
inf_aps_pos_eff = Simulink.Signal(StorageClass="ImportedExtern", DataType="fixdt(1, 16, 1/128)")
cantx_0x191_canframe = Simulink.Signal(StorageClass="ExportedGlobal", DataType="Bus: canframe")